# Grasshopper definition 4_axis_PASTE(no heaters)_3Dprinter_GCODE_GENERATOR_template.gh (Grasshopper 1.0.7)

# ---- group: generate a toolpath
xy = XYPlane(Origin=Point(0, 0, 0))
pi = Pi(Factor=2)
resolution = Slider(80, range=0..500)
layer_height = Slider(1.5, range=0..5)
layers = Slider(20, range=0..100)
dom = ConstructDomain(DomainStart=0, DomainEnd=pi)
range = Range(Domain=dom, Steps=resolution)
series = Series(Start=0, Step=layer_height, Count=layers)  # -> simplify(graft(Series))
panel = Panel(series)
pt = PointCylindrical(BasePlane=xy, Angle=range, Radius=Slider(30, range=0..100), Elevation=series)  # -> simplify(Point)

# ----
flowrate_factor = Slider(0.35, range=0..1)

# ---- group: calculate distances between adjacent points (for extrussion)
pline = PolyLine(Vertices=pt, Closed=False)  # -> simplify(Polyline)
explode = Explode(Curve=pline, Recursive=True)  # -> Segments, Vertices
len = Length(Curve=explode.Segments)  # -> simplify(Length)
panel_2 = Panel(len)
multiplication = Multiplication(A=panel_2, B=flowrate_factor)
panel_3 = Panel(multiplication)

# ---- group: just for previewing the toolpath
order = PointOrder(Points=pt)

# ---- group: get the cords of each point
deconstruct = Deconstruct(Point=pt)  # -> XComponent, YComponent, ZComponent

# ---- group: round numbers to only two decimals
max_decimal_places = Slider(2, range=0..10)
eval = Evaluate(F="Round(x,y)", x=deconstruct.XComponent, y=max_decimal_places)
eval_2 = Evaluate(F="Round(x,y)", x=deconstruct.YComponent, y=max_decimal_places)
eval_3 = Evaluate(F="Round(x,y)", x=deconstruct.ZComponent, y=max_decimal_places)
eval_4 = Evaluate(F="Round(x,y)", x=multiplication, y=max_decimal_places)

# ---- group: take the coords and produce a gcode line in text format
addition = Addition(A=eval_3, B=1.25)
format = Format(Format="G1 X{0} Y{1} Z{2} E{3}", Culture=127, Data0=eval, Data1=eval_2, Data2=addition, Data3=eval_4)

# ---- group: reset 4th axis (extruder) to zero after every extruded segment
concat = Concatenate(FragmentC="G92 E0")
concat_2 = Concatenate(FragmentA=format, FragmentB=concat)  # -> flatten(Result)

# ---- group: pre-pend gcode
feed_arte_printing_speed = Slider(600, range=0..2000)
concat_3 = Concatenate(FragmentA="G1 F", FragmentB=feed_arte_printing_speed)

# ---- group: pre- and post- pend gcode (home at start and end)
panel_4 = Panel("G28")

# ----
merge = Merge(Data1=panel_4, Data2=concat_3, Data4=flatten(concat_2), Data5=panel_4)
final_g_code = Panel(merge)
